# Grasshopper definition vizualize_pnts.ghx (Grasshopper 1.0.7)

# 139,308 is the total number of points
# for R1 work volume at 0.1m spacing
# x: -1.5 --> 6.0
# y: 0.3 --> 4.9
# z: -0.4 --> 3.4
# 
# 139,308 is the total number of points
# for R2 work volume at 0.1m spacing
# x: -1.5 --> 6.0
# y: -1.5 --> 3.1
# z: -0.4 --> 3.4
# 
# 162,240 is the total number of points
# for R3 work volume at 0.1m spacing
# x: 1.7 --> 8.0
# y: -1.5 --> 4.9
# z: -0.4 --> 3.4
# 
# 243,360 is the total number of points
# for 3 robot work volume at 0.1m spacing
# x: -1.5 --> 8.0
# y: -1.5 --> 4.9
# z: -0.4 --> 3.4
panel = Panel("{}/_{}_TOTAL.json")

panel_2 = Panel("/Users/edvard/Documents/github/rob_fab_reach/_data_track")
number_slider = Slider(100, range=1..100)
list = ValueList({"Robot 1": "rob1", "Robot 2": "rob2", "Robot 3": "rob3", "Robot 1&2": "rob1,rob2", "Robot 1&3": "rob1,rob3", "Robot 2&3": "rob2,rob3", "Robot 1&2&3": "rob1,rob2,rob3"}, selected="Robot 1&2")

angle = Slider(20, range=0..45)
width = Slider(10, range=0..10)
aspect_ratio = Slider(0.6, range=0.1..2)
pt = Point(Point(4.047665691, 1.724886209, 0.04008260369))

data = Data(panel_2)
data_2 = Data(list)

aspect_ratio_2 = Panel("""0.25
0.50
0.75
1.00
1.50""")
angles = Panel("""0
15
30
45""")
widths = Panel("""2
3
4
5
6""")
python = GhPythonScript(p=pt, angles=angles, widths=widths, ratios=aspect_ratio_2)  # -> out, simplify(points_out); inputs p: Point3d, angles: list, widths: list, ratios: list
# ---------- python: Python ----------
__author__ = "Edvard"
__version__ = "2023.06.12"

import rhinoscriptsyntax as rs
import ghpythonlib.treehelpers as th
from Rhino.Geometry import Vector3d

import math
from copy import deepcopy

width_sublist = [[] for i in range(len(widths))]
print width_sublist

point_sets = [deepcopy(width_sublist) for i in range(len(angles))]

#point_sets = [[] for i in range(len(angles))]

print point_sets


for i,angle in enumerate(angles):
    for j,width in enumerate(widths):
        for ratio in ratios:
            v1 = Vector3d(0,0,0)
            v2 = Vector3d(-width,0,0)
            
            #make end points
            p_start= rs.CopyObject(p,v1)
            p_end = rs.CopyObject(p,v2)
            
            height = (width/2)*ratio
            
            v3 = Vector3d(-width/2,0,height)
            p_mid = rs.CopyObject(p,v3)
            
            p_mid_new = rs.RotateObject(p_mid,p,angle,axis=Vector3d(-1,0,0),copy=True)
            
            point_set = [p_start, p_mid_new, p_end]
            point_sets[i][j].append(point_set)

print point_sets
points_out = th.list_to_tree(point_sets)

print points_out
# ---------- end python ----------

# ----
# 'n' robots reach
# (0 and 1, equivalent to No/Yes)
# (2 and 3, if you are reading in data for 2 or 3 robs)
number_slider_2 = Slider(3, range=0..3)
# single direction reachability
data_3 = Data(panel_2)
data_4 = Data("{}/{}_vec{:0>3}.json")
data_5 = Data(list)
data_6 = Data(Slider(50, range=1..100))
python_2 = GhPythonScript(path=data_3, name=data_4, rob_num=data_5, step_num=data_6, read_data=Toggle(False))  # -> points, values, vector; inputs step_num: Int32
# ---------- python_2: Python ----------
import os
import json
from compas_fab.utilities import read_data_from_json
from compas_fab.robots import Configuration


def initialize_count(rob_num):
    
    point_count = {}
    
    for rob in rob_num:
        print rob
        filename = name.format(rob,rob,1) # just take first to init
        filepath = os.path.join(path, filename)
        
        print filepath
        
        with open(filepath, "r") as f:
            file_data = f.read()
            
        f.close()
        
        data = json.loads(file_data)
        point_count.update(data['results'])
        
        print len(point_count)
        
    for key in point_count:
        point_count[key] = 0
    
    return point_count


if read_data:
    
    rob_num = rob_num.split(",")
    point_count = initialize_count(rob_num)
    
    for rob in rob_num:
        print "read", rob
        filename = name.format(rob,rob,step_num)
        filepath = os.path.join(path, filename)
    
        with open(filepath, "r") as f:
            file_data = f.read()
            data = json.loads(file_data)
            f.close()
        
        for pnt,result in data['results'].items():
            if result:
                point_count[pnt] += 1
                    
    vector = data['vector']
    points = point_count.keys()
    values = point_count.values()
# ---------- end python_2 ----------

# ----
# SINGLE ARCH
division = Division(A=graft(width), B=2)
rad = Radians(Degrees=graft(angle))
multiplication = Multiplication(A=division, B=graft(aspect_ratio))
X = UnitX(Factor=expr("-x", division))
Z = UnitZ(Factor=multiplication)
X_2 = UnitX(Factor=division)
move = Move(Geometry=pt, Motion=Z)  # -> Geometry, Transform
X_3 = UnitX(Factor=-1)
move_2 = Move(Geometry=pt, Motion=[X_2, X])  # -> Geometry, Transform
rot3d = Rotate3D(Geometry=move.Geometry, Angle=rad, Center=pt, Axis=X_3)  # -> Geometry, Transform
item = ListItem(List=move_2.Geometry, Index=0, Wrap=True)  # -> Item, Item1
merge = Merge(Data1=item.Item, Data2=rot3d.Geometry, Data3=item.Item1)

# ----
# if FALSE then show all
number_slider_3 = Slider(0, range=0..10)
ratio_idx = Slider(1, range=0..10)
python_3 = GhPythonScript(
    angle_idx=number_slider_3,
    angle_filter=Toggle(True),
    width_idx=Slider(3, range=0..10),
    width_filter=Toggle(True),
    ratio_idx=ratio_idx,
    ratio_filter=Toggle(False))  # -> out, path; inputs angle_idx: Int32, width_idx: Int32, ratio_idx: Int32
# ---------- python_3: Python ----------
__author__ = "Edvard"
__version__ = "2023.06.12"

import rhinoscriptsyntax as rs

if angle_filter:
    i = angle_idx
else:
    i = "?"

if width_filter:
    j = width_idx
else:
    j = "?"
    
if ratio_filter:
    k = ratio_idx
else:
    k = "?"

path = "{{{};{};{}}}".format(i,j,k)

print path
# ---------- end python_3 ----------

data_7 = Data("{}/{}_vec{:0>3}.json")

# ----
# cumulative reachability
data_8 = Data(panel_2)
data_9 = Data(list)
data_10 = Data(number_slider)
python_4 = GhPythonScript(path=data_8, name=data_7, rob_num=data_9, step_num=data_10, read_data=Toggle(False))  # -> points, values, coop_points, simplify(vectors); inputs step_num: Int32
# ---------- python_4: Python ----------
import os
import json
from compas_fab.utilities import read_data_from_json
from compas_fab.robots import Configuration

import ghpythonlib.treehelpers as th

"""


243,360 is the total number of points
for 3 robot work volume at 0.1m spacing
x: -1.5 --> 8.0
y: -1.5 --> 4.9
z: -0.4 --> 3.4
"""

def initialize_count(rob_num):
    
    point_count = {}
    
    for rob in rob_num:
        filename = name.format(rob,rob,1) # just take first to init
        filepath = os.path.join(path, filename)
        
        #print rob,filepath
        
        with open(filepath, "r") as f:
            file_data = f.read()
            
        f.close()
        
        data = json.loads(file_data)
        point_count.update(data['results'])
        
        print len(point_count)
        
    for key in point_count:
        point_count[key] = 0
    
    return point_count

    

if read_data:
    
    rob_num = rob_num.split(",")
    
    point_count = initialize_count(rob_num)
    cooperative_count_save = initialize_count(rob_num)
    vectors = []
    
        
    for i in range(1,step_num+1):
        
        cooperative_count = initialize_count(rob_num)

        for rob in rob_num:
            print "{}: vector {}".format(rob,i)
            
            filename = name.format(rob,rob,i)
            filepath = os.path.join(path, filename)
            
            with open(filepath, "r") as f:
                file_data = f.read()
                data = json.loads(file_data)
                f.close()
                
                vec = data['vector']
                vectors.append(vec)
            
            for pnt,result in data['results'].items():
                if result:
                    cooperative_count[pnt] += 1
                    point_count[pnt] += 1
                    
        
        for pnt,result in cooperative_count.items():
            if result == len(rob_num):
                cooperative_count_save[pnt] = 1
            
        
    vectors = th.list_to_tree(vectors, source=[0,0])
    points = point_count.keys()
    values = point_count.values()
    
    coop_points = cooperative_count_save.values()

    print points
# ---------- end python_4 ----------
int = Integer(python_4.values)
pt_2 = Point(python_4.points)
int_2 = Integer(python_4.coop_points)
num = Number(python_4.vectors)

int_3 = Integer(int)
data_11 = Data(list)
data_12 = Data(number_slider)
values = GhPythonScript(rob_num=data_11, values=int_3, n_steps=data_12)  # -> max_index, max_counts, counts; inputs values: list, n_steps: Int32
# ---------- values: Python ----------
counts = []

rob_num = rob_num.split(",")

max = n_steps * len(rob_num)

for i in range(0,max + 1):
    counts.append(values.count(i))

max_save = 0
for i,cnt in enumerate(counts):
    
    if cnt:
        max_index = i

max_counts = counts[max_index]
# ---------- end values ----------
panel_3 = Panel(values.counts)
panel_4 = Panel(values.max_index)
panel_5 = Panel(values.max_counts)
rec = DataRecorder(panel_5, DataLimit=-10, RecordData=False)
panel_6 = Panel(rec)

python_5 = GhPythonScript(path=data, name=panel, rob_num=data_2, step_num=Slider(100, range=1..100), read_data=Toggle(False))  # -> points, values, coop_points, simplify(vectors); inputs step_num: Int32
# ---------- python_5: Python ----------
import os
import json
from compas_fab.utilities import read_data_from_json
from compas_fab.robots import Configuration

from copy import deepcopy

import ghpythonlib.treehelpers as th

"""


243,360 is the total number of points
for 3 robot work volume at 0.1m spacing
x: -1.5 --> 8.0
y: -1.5 --> 4.9
z: -0.4 --> 3.4
"""

def count_data(rob_num):
    count_total = {}
    count_cooperative = {}
    
    #read in data based on how many robots
    filepaths = [os.path.join(path, name.format(rob,rob)) for rob in rob_num]
    files = [open(filepath, "r") for filepath in filepaths]
    datas = [json.loads(file.read()) for file in files]
    
    for f in files:
        f.close()
    
    #initialize the dictionary, each unique point
    for data in datas:
        count_total.update(data['results'])
    
    #zero all the values in the dictionary
    for key in count_total:
        count_total[key] = 0
        
    count_cooperative = deepcopy(count_total)
    
    #read in all data, sum in total count, sum in # robs reached
    for data in datas:
        for key,value in data['results'].items():
            
            if value:
                count_total[key] += value
                count_cooperative[key] += 1

    return count_total, count_cooperative



if read_data:
    rob_num = rob_num.split(",")
    
    count_total,count_cooperative = count_data(rob_num)
    
    #binary if cooperative or not
    for key,value in count_cooperative.items():
        if value == len(rob_num):
            count_cooperative[key] = 1
    
    points = count_total.keys()
    values = count_total.values()
    coop_points = count_cooperative.values()
    
    #    vectors = th.list_to_tree(vectors, source=[0,0])
    
    print count_total, count_cooperative
# ---------- end python_5 ----------

int_4 = Integer(number_slider_2)
mindex = MemberIndex(Set=python_2.values, Member=int_4)  # -> Index, Count
dispatch = Dispatch(List=python_2.points, DispatchPattern=python_2.values)  # -> ListA, ListB
item_2 = ListItem(List=python_2.points, Index=mindex.Index, Wrap=True)

# ----
# 3D GRID OF ARCHES
pt_3 = Point(python.points_out)
viewer = ParamViewer(python.points_out)
panel_7 = Panel(python_3.path)
split = SplitTree(Data=python.points_out, Masks=flatten(python_3.path))  # -> Positive, Negative
viewer_2 = ParamViewer(split.Positive)

# ----
# View Reach Vector
item_3 = ListItem(List=python_2.vector, Index=0, Wrap=True)  # -> Item, Item1, Item2
panel_8 = Panel(python_2.vector)
pt_4 = ConstructPoint(XCoordinate=0, YCoordinate=-5, ZCoordinate=0)
vec = VectorXYZ(XComponent=item_3.Item, YComponent=item_3.Item1, ZComponent=item_3.Item2)  # -> Vector, Length
vdisex = VectorDisplayEx(Point=pt_4, Vector=vec.Vector, Colour=ColourSwatch(SwatchColor=RGB(252, 167, 167)), Width="8")

# ----
# See all points
pt_5 = Point(pt_2)
panel_9 = Panel(panel_4)
int_5 = Integer(int)
gradient = Gradient(
    LowerLimit="0",
    UpperLimit=panel_9,
    Parameter=int_5,
    stops=[0: RGB(255, 255, 255), 0.1: RGB(236, 27, 60), 0.2: RGB(210, 0, 118), 0.3: RGB(103, 0, 120), 0.4: RGB(39, 72, 161), 0.5: RGB(1, 192, 229), 0.6: RGB(18, 178, 90), 0.7: RGB(79, 186, 8), 0.8: RGB(220, 237, 32), 0.9: RGB(247, 159, 20), 1: RGB(243, 57, 0)])
gradient_2 = Gradient(
    LowerLimit="0",
    UpperLimit=panel_9,
    Parameter=int_5,
    stops=[0: RGB(255, 255, 255), 0.8: RGB(255, 0, 0), 0.986: RGB(145, 0, 0), 1: RGB(0, 0, 0)])
preview = CustomPreview(Geometry=pt_5, Material=gradient)

# ----
# See points where there is cooperative reach (multi robots can reach)
pt_6 = Point(pt_2)
int_6 = Integer(int_2)
int_7 = Integer(int)
int_8 = Integer(int_2)
dispatch_2 = Dispatch(List=pt_6, DispatchPattern=int_6)  # -> ListA, ListB
dispatch_3 = Dispatch(List=int_7, DispatchPattern=int_8)  # -> ListA, ListB
panel_10 = Panel(panel_4)
gradient_3 = Gradient(
    LowerLimit="0",
    UpperLimit=panel_10,
    Parameter=dispatch_3.ListA,
    stops=[0: RGB(255, 255, 255), 0.1: RGB(236, 27, 60), 0.2: RGB(210, 0, 118), 0.3: RGB(103, 0, 120), 0.4: RGB(39, 72, 161), 0.5: RGB(1, 192, 229), 0.6: RGB(18, 178, 90), 0.7: RGB(79, 186, 8), 0.8: RGB(220, 237, 32), 0.9: RGB(247, 159, 20), 1: RGB(243, 57, 0)])
pt_7 = Point(dispatch_2.ListA)
preview_2 = CustomPreview(Geometry=pt_7, Material=gradient_3)

# ----
# See points with a specified % of maximum reaches
pt_8 = Point(pt_2)
int_9 = Integer(int)
panel_11 = Panel(panel_4)
multiplication_2 = Multiplication(A=panel_11, B=Slider(1, range=0..1))
larger = LargerThan(FirstNumber=int_9, SecondNumber=multiplication_2)  # -> LargerThan, OrEqualTo
dispatch_4 = Dispatch(List=pt_8, DispatchPattern=larger.OrEqualTo)  # -> ListA, ListB
preview_3 = CustomPreview(Geometry=dispatch_4.ListA, Material=ColourSwatch(SwatchColor=RGB(217, 80, 80)))

# ----
# See points with 100% of maximum reaches
pt_9 = Point(pt_2)
int_10 = Integer(int)
panel_12 = Panel(panel_4)
int_11 = Integer(panel_12)
mindex_2 = MemberIndex(Set=int_10, Member=int_11)  # -> Index, Count
item_4 = ListItem(List=pt_9, Index=mindex_2.Index, Wrap=True)
preview_4 = CustomPreview(Geometry=item_4, Material=ColourSwatch(SwatchColor=RGB(0, 0, 0)))

# ----
# See points with a specified number of reaches
pt_10 = Point(pt_2)
int_12 = Integer(int)
int_13 = Integer("0")
mindex_3 = MemberIndex(Set=int_12, Member=int_13)  # -> Index, Count
item_5 = ListItem(List=pt_10, Index=mindex_3.Index, Wrap=True)
preview_5 = CustomPreview(Geometry=item_5, Material=ColourSwatch(SwatchColor=RGB(0, 34, 255)))

num_2 = Number(num)
flip = FlipMatrix(Data=num_2)
branch = TreeBranch(Tree=flip, Path="{1}", MaintainPaths=True)
branch_2 = TreeBranch(Tree=flip, Path="{2}", MaintainPaths=True)
branch_3 = TreeBranch(Tree=flip, Path="{0}", MaintainPaths=True)
pt_11 = ConstructPoint(XCoordinate=6, YCoordinate=-3, ZCoordinate=0)
vec_2 = VectorXYZ(XComponent=branch_3, YComponent=branch, ZComponent=branch_2)  # -> Vector, Length
vdisex_2 = VectorDisplayEx(Point=pt_11, Vector=vec_2.Vector, Colour=RGB(0, 0, 0), Width="1")

# ----
# YES reach
lng = ListLength(List=dispatch.ListA)
panel_13 = Panel(lng)
preview_6 = CustomPreview(Geometry=dispatch.ListA, Material=ColourSwatch(SwatchColor=RGB(0, 34, 255)))

# ----
# NO reach
lng_2 = ListLength(List=dispatch.ListB)
panel_14 = Panel(lng_2)
preview_7 = CustomPreview(Geometry=dispatch.ListB, Material=ColourSwatch(SwatchColor=RGB(0, 0, 0)))

# ----
# 'n' robot reach
lng_3 = ListLength(List=item_2)
panel_15 = Panel(lng_3)
preview_8 = CustomPreview(Geometry=item_2, Material=ColourSwatch(SwatchColor=RGB(250, 12, 12)))

# ----
# draw brick volumes tangent to the curve. unique number of bricks per leg of arch.
pt_12 = Point(split.Positive)
intcrv = Interpolate(Vertices=pt_12, Degree=3, Periodic=False, KnotStyle=1)  # -> Curve, Length, Domain
len = Length(Curve=flatten(intcrv.Curve))
division_2 = Division(A="0.075", B=2)
division_3 = Division(A="0.225", B=2)
division_4 = Division(A="0.1125", B=2)
division_5 = Division(A=len, B="0.075")
crv = Curve(intcrv.Curve)
int_14 = Integer(graft(division_5))
divide = DivideCurve(Curve=crv, Count=int_14, Kinks=False)  # -> Points, Tangents, Parameters
pframe = PerpFrame(Curve=crv, Parameter=divide.Parameters)
box = CenterBox(Base=pframe, X=division_3, Y=division_4, Z=division_2)

# ----
# visualize volumes
# search domain, diagonal corners
# R1
panel_16 = Panel("{-1.5,4.9,-0.4}")
pt_13 = Point(panel_16)
pt_14 = Point("{6.0,0.3,3.4}")
box_2 = Box2Pt(PointA=pt_13, PointB=pt_14, Plane=PlaneXY(0, 0, 0))
preview_9 = CustomPreview(Geometry=box_2, Material=ColourSwatch(SwatchColor=RGBA(255, 0, 0, 64)))

# ----
# R2
panel_17 = Panel("{-1.5,-1.5,-0.4}")
pt_15 = Point(panel_17)
pt_16 = Point("{6.0,3.1,3.4}")
box_3 = Box2Pt(PointA=pt_15, PointB=pt_16, Plane=PlaneXY(0, 0, 0))
preview_10 = CustomPreview(Geometry=box_3, Material=ColourSwatch(SwatchColor=RGBA(0, 34, 255, 64)))

# ----
# R3
panel_18 = Panel("{1.7,-1.5,-0.4}")
pt_17 = Point(panel_18)
pt_18 = Point("{8.0,4.9,3.4}")
box_4 = Box2Pt(PointA=pt_17, PointB=pt_18, Plane=PlaneXY(0, 0, 0))
preview_11 = CustomPreview(Geometry=box_4, Material=ColourSwatch(SwatchColor=RGBA(255, 255, 0, 64)))

panel_19 = Panel("collision mesh (ground)")
pt_19 = Point("{7,6,-0.375}")
pt_20 = Point("{-3,-3,-0.4}")
box_5 = Box2Pt(PointA=pt_20, PointB=pt_19, Plane=PlaneXY(0, 0, 0))

sint = SolidIntersection(BrepsA=box_3, BrepsB=box_2)
sdiff = SolidDifference(BrepsA=box_3, BrepsB=box_2)
sdiff_2 = SolidDifference(BrepsA=box_2, BrepsB=box_3)
sint_2 = SolidIntersection(BrepsA=sint, BrepsB=box_4)
sdiff_3 = SolidDifference(BrepsA=sint, BrepsB=box_4)
preview_12 = CustomPreview(Geometry=sint_2, Material=ColourSwatch(SwatchColor=RGBA(255, 0, 0, 64)))
preview_13 = CustomPreview(Geometry=sdiff_3, Material=ColourSwatch(SwatchColor=RGBA(255, 255, 0, 64)))
preview_14 = CustomPreview(Geometry=[sdiff, sdiff_2], Material=ColourSwatch(SwatchColor=RGBA(0, 34, 255, 64)))
